% Simulink data dictionary BldcData.sldd

BldcBool_T = Simulink.AliasType(BaseType="boolean")  % BLDC logical storage
BldcCurrent_V = Simulink.ValueType(DataType="BldcSingle_T", Unit="A", be=Simulink.BusElement(Name="a", DataType="double"))  % Phase current
BldcInt32_T = Simulink.AliasType(BaseType="int32")  % BLDC int32 storage
BldcInt8_T = Simulink.AliasType(BaseType="int8")  % BLDC int8 storage
BldcRaw16_T = Simulink.NumericType(DataTypeMode="Fixed-point: binary point scaling", SignednessBool=false, WordLength=16, FixedExponent=0)  % Unsigned raw 16-bit representation
BldcSingle_T = Simulink.AliasType(BaseType="single")  % BLDC single storage
BldcTime_V = Simulink.ValueType(DataType="BldcSingle_T", Min=0, Unit="s", be=Simulink.BusElement(Name="a", DataType="double"))  % Time in seconds
BldcUInt16_T = Simulink.AliasType(BaseType="uint16")  % BLDC uint16 storage
BldcUInt32_T = Simulink.AliasType(BaseType="uint32")  % BLDC uint32 storage
BldcUInt8_T = Simulink.AliasType(BaseType="uint8")  % BLDC uint8 storage
BldcVoltage_V = Simulink.ValueType(DataType="BldcSingle_T", Unit="V", be=Simulink.BusElement(Name="a", DataType="double"))  % Measured voltage

eBldcPositionMode = enum(DefaultValue="Hall", StorageType="uint8")
  Hall = 0  % Hall edge feedback
  Sensorless = 1  % Terminal voltage zero crossing feedback

tBldcDebug = Simulink.Bus()  % Fixed-size BLDC debug interface.
  Enabled: BldcBool_T  % Enabled
  Data: BldcSingle_T[16]  % 16 ordered monitor channels; see bldc.monitor

BldcInput_Default = Simulink.Parameter(struct(
  CurrentRaw=uint16([32768; 32768; 32768]),
  Hall=uint8(5),
  TerminalVoltage=single([6; 6; 6]),
  Control=uint8(0),
  Fault=false,
  CommandEvent=true,
  DrivingEvent=true,
  TimerEvent=true,
  SpeedReq=single(0),
  Vdc=single(12),
  AppliedSector=uint8(0),
  AppliedDirection=int8(1),
  VoltageValid=true), DataType="Bus: tBldcInput")

AmbdOutputsArmed = Simulink.Parameter(false, StorageClass="ExportedGlobal", Alias="Ambd_OutputsArmed", DataType="boolean")

tBldcInput = Simulink.Bus()  % Fixed-size BLDC input interface.
  CurrentRaw: BldcUInt16_T[3]  % Phase ADC encodings; DC-link mode uses element 1 only
  Hall: BldcUInt8_T  % Hall
  TerminalVoltage: BldcSingle_T[3]  % Three phase terminal voltages; DC-link mode qualifies the applied floating phase only
  Control: BldcUInt8_T  % Control
  Fault: BldcBool_T  % Fault
  CommandEvent: BldcBool_T  % CommandEvent
  DrivingEvent: BldcBool_T  % DrivingEvent
  TimerEvent: BldcBool_T  % TimerEvent
  SpeedReq: BldcSingle_T  % SpeedReq
  Vdc: ValueType: BldcVoltage_V  % Vdc
  AppliedSector: BldcUInt8_T  % AppliedSector
  AppliedDirection: BldcInt8_T  % AppliedDirection
  VoltageValid: BldcBool_T  % VoltageValid

tBldcMonitor = Simulink.Bus()  % Fixed-size BLDC monitor interface.
  Mode: BldcUInt8_T  % Mode
  FaultBits: BldcUInt16_T  % FaultBits
  Tick: BldcUInt32_T  % Tick
  Current: BldcSingle_T[3]  % Three phase currents in A
  CurrentReference: ValueType: BldcCurrent_V  % CurrentReference
  CurrentDemand: ValueType: BldcCurrent_V  % Saturated speed-loop current demand before slew
  SpeedRequest: BldcSingle_T  % SpeedRequest
  SpeedRamped: BldcSingle_T  % SpeedRamped
  SpeedEstimate: BldcSingle_T  % SpeedEstimate
  ControlSpeed: BldcSingle_T  % ControlSpeed
  Sector: BldcUInt8_T  % Sector
  Direction: BldcInt8_T  % Direction
  OutputDirection: BldcInt8_T  % OutputDirection
  Modulation: BldcSingle_T  % Modulation
  GateEnable: BldcBool_T  % GateEnable
  PhaseEnable: BldcBool_T[3]  % PhaseEnable
  FeedbackReady: BldcBool_T  % FeedbackReady
  ZcCount: BldcUInt16_T  % ZcCount
  ZcPeriod: BldcSingle_T  % ZcPeriod
  ZcCountdown: BldcInt32_T  % ZcCountdown
  AcquisitionReady: BldcBool_T  % Terminal voltage coast acquisition qualified
  PositionMode: BldcUInt8_T  % 0 Hall; 1 terminal-voltage sensorless
  VoltageResidual: BldcSingle_T  % VoltageResidual
  CurrentIntegrator: BldcSingle_T  % CurrentIntegrator
  SpeedIntegrator: BldcSingle_T  % SpeedIntegrator
  HallSector: BldcUInt8_T  % HallSector
  HallValid: BldcBool_T  % HallValid
  AppliedAge: BldcUInt32_T  % AppliedAge
  CurrentMeasured: ValueType: BldcCurrent_V  % CurrentMeasured
  CurrentSenseMode: BldcUInt8_T  % 0 phase sensors; 1 DC-link shunt
  PhaseCurrentsValid: BldcBool_T  % Validity of the Current vector
  DcCurrent: ValueType: BldcCurrent_V  % Last valid DC-link current
  DcCurrentValid: BldcBool_T  % Validity of this DC-link sample

tBldcRuntime = Simulink.Bus()  % Fixed-size BLDC runtime interface.
  Parameters: Bus: tBldcParams  % Complete independent controller calibration
  Mode: BldcUInt8_T  % Mode
  PreviousMode: BldcUInt8_T  % PreviousMode
  ModeTicks: BldcUInt32_T  % ModeTicks
  Tick: BldcUInt32_T  % Tick
  SlowCounter: BldcUInt16_T  % SlowCounter
  FastTick: BldcBool_T  % FastTick
  SpeedTick: BldcBool_T  % SpeedTick
  Command: BldcUInt8_T  % Command
  SpeedRequest: BldcSingle_T  % SpeedRequest
  SpeedRamped: BldcSingle_T  % SpeedRamped
  CoastTicks: BldcUInt32_T  % CoastTicks
  Direction: BldcInt8_T  % Direction
  OutputDirection: BldcInt8_T  % OutputDirection
  Sector: BldcUInt8_T  % Sector
  GateEnable: BldcBool_T  % GateEnable
  PhaseEnable: BldcBool_T[3]  % PhaseEnable
  DutyCounts: BldcUInt16_T[3]  % DutyCounts
  Modulation: BldcSingle_T  % Modulation
  Current: BldcSingle_T[3]  % Three phase currents in A
  CurrentRef: ValueType: BldcCurrent_V  % CurrentRef
  CurrentDemand: ValueType: BldcCurrent_V  % Saturated speed-loop current demand before slew
  CurrentMeasured: ValueType: BldcCurrent_V  % CurrentMeasured
  CurrentIntegrator: BldcSingle_T  % CurrentIntegrator
  SpeedIntegrator: BldcSingle_T  % SpeedIntegrator
  SpeedEstimate: BldcSingle_T  % SpeedEstimate
  ControlSpeed: BldcSingle_T  % ControlSpeed
  RawSpeed: BldcSingle_T  % RawSpeed
  HallLast: BldcUInt8_T  % HallLast
  HallSector: BldcUInt8_T  % HallSector
  HallAge: BldcUInt32_T  % HallAge
  HallValid: BldcBool_T  % HallValid
  HallDirection: BldcInt8_T  % HallDirection
  FeedbackReady: BldcBool_T  % FeedbackReady
  OmegaOpen: BldcSingle_T  % OmegaOpen
  ThetaOpen: BldcSingle_T  % ThetaOpen
  AppliedLastSector: BldcUInt8_T  % AppliedLastSector
  AppliedAge: BldcUInt32_T  % AppliedAge
  ZcAge: BldcUInt32_T  % ZcAge
  ZcPeriod: BldcSingle_T  % ZcPeriod
  ZcCount: BldcUInt16_T  % ZcCount
  ZcFound: BldcBool_T  % ZcFound
  ZcArmed: BldcBool_T  % ZcArmed
  ZcValue: BldcSingle_T  % ZcValue
  ZcCountdown: BldcInt32_T  % ZcCountdown
  ZcNextSector: BldcUInt8_T  % ZcNextSector
  AcquireStage: BldcUInt8_T  % AcquireStage
  AcquireTheta: BldcSingle_T  % AcquireTheta
  AcquireAge: BldcUInt32_T  % AcquireAge
  AcquisitionReady: BldcBool_T  % Terminal voltage coast acquisition qualified
  SensorFault: BldcUInt16_T  % SensorFault
  ActiveFaults: BldcUInt16_T  % ActiveFaults
  FaultBits: BldcUInt16_T  % FaultBits
  PhaseCurrentsValid: BldcBool_T  % True only for actual phase-current sensing
  DcCurrent: ValueType: BldcCurrent_V  % Last valid DC-link current; not a three-phase reconstruction
  DcCurrentValid: BldcBool_T  % Current frame sampled in a qualified conduction window
  ZcUnclampedCount: BldcUInt16_T  % Consecutive floating-voltage rail-release observations

tBldcParams = Simulink.Bus()  % Fixed-size BLDC params interface.
  Ts: ValueType: BldcTime_V  % Ts
  SpeedDivider: BldcUInt16_T  % SpeedDivider
  AdcOffset: BldcSingle_T  % AdcOffset
  AdcCountsPerAmp: BldcSingle_T  % AdcCountsPerAmp
  PwmPeriod: BldcUInt16_T  % PwmPeriod
  Rs: BldcSingle_T  % Rs
  Ls: BldcSingle_T  % Ls
  Ke: BldcSingle_T  % Ke
  PolePairs: BldcUInt8_T  % PolePairs
  Inertia: BldcSingle_T  % Inertia
  Friction: BldcSingle_T  % Friction
  PlantSubsteps: BldcUInt16_T  % PlantSubsteps
  NominalVdc: ValueType: BldcVoltage_V  % NominalVdc
  VdcMin: ValueType: BldcVoltage_V  % VdcMin
  VdcMax: ValueType: BldcVoltage_V  % VdcMax
  CurrentLimit: BldcSingle_T  % CurrentLimit
  TripCurrent: BldcSingle_T  % TripCurrent
  SpeedLimit: BldcSingle_T  % SpeedLimit
  MaxModulation: BldcSingle_T  % MaxModulation
  KpCurrent: BldcSingle_T  % KpCurrent
  KiCurrent: BldcSingle_T  % KiCurrent
  KpSpeed: BldcSingle_T  % KpSpeed
  KiSpeed: BldcSingle_T  % KiSpeed
  SpeedSlew: BldcSingle_T  % SpeedSlew
  CurrentSlew: BldcSingle_T  % CurrentSlew
  AlignTime: BldcSingle_T  % AlignTime
  AlignCurrent: BldcSingle_T  % AlignCurrent
  OpenCurrent: BldcSingle_T  % OpenCurrent
  OpenAccel: BldcSingle_T  % OpenAccel
  OpenSpeed: BldcSingle_T  % OpenSpeed
  TrackingTime: BldcSingle_T  % TrackingTime
  TrackingTimeout: BldcSingle_T  % Maximum tracking qualification duration
  StartTimeout: BldcSingle_T  % StartTimeout
  StopSpeed: BldcSingle_T  % StopSpeed
  StopTimeout: BldcSingle_T  % StopTimeout
  StopCoastTime: BldcSingle_T  % StopCoastTime
  HallTimeout: BldcSingle_T  % HallTimeout
  HallStartTimeout: BldcSingle_T  % HallStartTimeout
  HallStallCurrent: BldcSingle_T  % HallStallCurrent
  SpeedFilterAlpha: BldcSingle_T  % SpeedFilterAlpha
  HallGainSpeed: BldcSingle_T  % Electrical request in rad/s at full Hall speed-loop gains
  HallMinGainScale: BldcSingle_T  % Minimum Hall proportional gain scale; integral uses its square
  ZcBlankTicks: BldcUInt16_T  % ZcBlankTicks
  ZcHysteresis: BldcSingle_T  % ZcHysteresis
  FloatCurrentLimit: BldcSingle_T  % FloatCurrentLimit
  ZcMinTicks: BldcUInt32_T  % ZcMinTicks
  ZcMaxTicks: BldcUInt32_T  % ZcMaxTicks
  ZcRequired: BldcUInt16_T  % ZcRequired
  ZcTimeoutFactor: BldcSingle_T  % ZcTimeoutFactor
  ZcMinSpeed: BldcSingle_T  % ZcMinSpeed
  AcquireSpacing: BldcUInt16_T  % AcquireSpacing
  AcquireMinVoltage: BldcSingle_T  % AcquireMinVoltage
  AcquireTimeout: BldcSingle_T  % AcquireTimeout
  LowSpeedThreshold: BldcSingle_T  % LowSpeedThreshold
  PositionMode: BldcUInt8_T  % 0 Hall; 1 terminal-voltage sensorless
  CurrentSenseMode: BldcUInt8_T  % 0 three phase sensors; 1 valid-window DC-link shunt
  MinModulation: BldcSingle_T  % Minimum energized duty in DC-link mode
  DemagBlankFraction: BldcSingle_T  % Commutation-period fraction excluded after switching
  DemagRailMargin: BldcSingle_T  % Floating terminal must leave both clamp rails by this voltage
  DemagReleaseTicks: BldcUInt16_T  % Consecutive unclamped samples required before ZC arming
  ActuationDelayTicks: BldcUInt16_T  % Compensated output activation delay for DC-link commutation

BldcControl_Params = Simulink.Parameter(struct(
  Ts=single(6.25e-5),
  SpeedDivider=uint16(16),
  AdcOffset=single(32768),
  AdcCountsPerAmp=single(1000),
  PwmPeriod=uint16(65535),
  Rs=single(0.56),
  Ls=single(0.0004),
  Ke=single(0.00781045202),
  PolePairs=uint8(2),
  Inertia=single(1.2e-5),
  Friction=single(0.0005),
  PlantSubsteps=uint16(10),
  NominalVdc=single(12),
  VdcMin=single(8),
  VdcMax=single(16),
  CurrentLimit=single(6),
  TripCurrent=single(10),
  SpeedLimit=single(250),
  MaxModulation=single(0.95),
  KpCurrent=single(2.51327419),
  KiCurrent=single(3518.58398),
  KpSpeed=single(0.0226098206),
  KiSpeed=single(0.970476091),
  SpeedSlew=single(200),
  CurrentSlew=single(60),
  AlignTime=single(0.15),
  AlignCurrent=single(1.2),
  OpenCurrent=single(3.5),
  OpenAccel=single(100),
  OpenSpeed=single(120),
  TrackingTime=single(0.15),
  TrackingTimeout=single(1),
  StartTimeout=single(3),
  StopSpeed=single(8),
  StopTimeout=single(1.5),
  StopCoastTime=single(0.25),
  HallTimeout=single(0.3),
  HallStartTimeout=single(1),
  HallStallCurrent=single(0.5),
  SpeedFilterAlpha=single(0.02),
  HallGainSpeed=single(80),
  HallMinGainScale=single(0.2),
  ZcBlankTicks=uint16(4),
  ZcHysteresis=single(0.02),
  FloatCurrentLimit=single(0.05),
  ZcMinTicks=uint32(20),
  ZcMaxTicks=uint32(8000),
  ZcRequired=uint16(6),
  ZcTimeoutFactor=single(2.5),
  ZcMinSpeed=single(60),
  AcquireSpacing=uint16(4),
  AcquireMinVoltage=single(0.2),
  AcquireTimeout=single(0.01),
  LowSpeedThreshold=single(75),
  PositionMode=uint8(0),
  CurrentSenseMode=uint8(0),
  MinModulation=single(0),
  DemagBlankFraction=single(0.2),
  DemagRailMargin=single(0.3),
  DemagReleaseTicks=uint16(2),
  ActuationDelayTicks=uint16(0)), DataType="Bus: tBldcParams")

BldcRuntime_Init = Simulink.Parameter(struct(
  Parameters=struct(
    Ts=single(6.25e-5),
    SpeedDivider=uint16(16),
    AdcOffset=single(32768),
    AdcCountsPerAmp=single(1000),
    PwmPeriod=uint16(65535),
    Rs=single(0.56),
    Ls=single(0.0004),
    Ke=single(0.00781045202),
    PolePairs=uint8(2),
    Inertia=single(1.2e-5),
    Friction=single(0.0005),
    PlantSubsteps=uint16(10),
    NominalVdc=single(12),
    VdcMin=single(8),
    VdcMax=single(16),
    CurrentLimit=single(6),
    TripCurrent=single(10),
    SpeedLimit=single(250),
    MaxModulation=single(0.95),
    KpCurrent=single(2.51327419),
    KiCurrent=single(3518.58398),
    KpSpeed=single(0.0226098206),
    KiSpeed=single(0.970476091),
    SpeedSlew=single(200),
    CurrentSlew=single(60),
    AlignTime=single(0.15),
    AlignCurrent=single(1.2),
    OpenCurrent=single(3.5),
    OpenAccel=single(100),
    OpenSpeed=single(120),
    TrackingTime=single(0.15),
    TrackingTimeout=single(1),
    StartTimeout=single(3),
    StopSpeed=single(8),
    StopTimeout=single(1.5),
    StopCoastTime=single(0.25),
    HallTimeout=single(0.3),
    HallStartTimeout=single(1),
    HallStallCurrent=single(0.5),
    SpeedFilterAlpha=single(0.02),
    HallGainSpeed=single(80),
    HallMinGainScale=single(0.2),
    ZcBlankTicks=uint16(4),
    ZcHysteresis=single(0.02),
    FloatCurrentLimit=single(0.05),
    ZcMinTicks=uint32(20),
    ZcMaxTicks=uint32(8000),
    ZcRequired=uint16(6),
    ZcTimeoutFactor=single(2.5),
    ZcMinSpeed=single(60),
    AcquireSpacing=uint16(4),
    AcquireMinVoltage=single(0.2),
    AcquireTimeout=single(0.01),
    LowSpeedThreshold=single(75),
    PositionMode=uint8(0),
    CurrentSenseMode=uint8(0),
    MinModulation=single(0),
    DemagBlankFraction=single(0.2),
    DemagRailMargin=single(0.3),
    DemagReleaseTicks=uint16(2),
    ActuationDelayTicks=uint16(0)),
  Mode=uint8(0),
  PreviousMode=uint8(0),
  ModeTicks=uint32(0),
  Tick=uint32(0),
  SlowCounter=uint16(0),
  FastTick=false,
  SpeedTick=false,
  Command=uint8(0),
  SpeedRequest=single(0),
  SpeedRamped=single(0),
  CoastTicks=uint32(0),
  Direction=int8(1),
  OutputDirection=int8(1),
  Sector=uint8(0),
  GateEnable=false,
  PhaseEnable=[false; false; false],
  DutyCounts=uint16([0; 0; 0]),
  Modulation=single(0),
  Current=single([0; 0; 0]),
  CurrentRef=single(0),
  CurrentDemand=single(0),
  CurrentMeasured=single(0),
  CurrentIntegrator=single(0),
  SpeedIntegrator=single(0),
  SpeedEstimate=single(0),
  ControlSpeed=single(0),
  RawSpeed=single(0),
  HallLast=uint8(0),
  HallSector=uint8(0),
  HallAge=uint32(0),
  HallValid=false,
  HallDirection=int8(0),
  FeedbackReady=false,
  OmegaOpen=single(0),
  ThetaOpen=single(2.61799383),
  AppliedLastSector=uint8(0),
  AppliedAge=uint32(0),
  ZcAge=uint32(0),
  ZcPeriod=single(0),
  ZcCount=uint16(0),
  ZcFound=false,
  ZcArmed=false,
  ZcValue=single(0),
  ZcCountdown=int32(-1),
  ZcNextSector=uint8(0),
  AcquireStage=uint8(0),
  AcquireTheta=single(0),
  AcquireAge=uint32(0),
  AcquisitionReady=false,
  SensorFault=uint16(0),
  ActiveFaults=uint16(0),
  FaultBits=uint16(0),
  PhaseCurrentsValid=true,
  DcCurrent=single(0),
  DcCurrentValid=false,
  ZcUnclampedCount=uint16(0)), DataType="Bus: tBldcRuntime")

BldcPlant_Params = Simulink.Parameter(struct(
  Ts=single(6.25e-5),
  SpeedDivider=uint16(16),
  AdcOffset=single(32768),
  AdcCountsPerAmp=single(1000),
  PwmPeriod=uint16(65535),
  Rs=single(0.56),
  Ls=single(0.0004),
  Ke=single(0.00781045202),
  PolePairs=uint8(2),
  Inertia=single(1.2e-5),
  Friction=single(0.0005),
  PlantSubsteps=uint16(10),
  NominalVdc=single(12),
  VdcMin=single(8),
  VdcMax=single(16),
  CurrentLimit=single(6),
  TripCurrent=single(10),
  SpeedLimit=single(250),
  MaxModulation=single(0.95),
  KpCurrent=single(2.51327419),
  KiCurrent=single(3518.58398),
  KpSpeed=single(0.0226098206),
  KiSpeed=single(0.970476091),
  SpeedSlew=single(200),
  CurrentSlew=single(60),
  AlignTime=single(0.15),
  AlignCurrent=single(1.2),
  OpenCurrent=single(3.5),
  OpenAccel=single(100),
  OpenSpeed=single(120),
  TrackingTime=single(0.15),
  TrackingTimeout=single(1),
  StartTimeout=single(3),
  StopSpeed=single(8),
  StopTimeout=single(1.5),
  StopCoastTime=single(0.25),
  HallTimeout=single(0.3),
  HallStartTimeout=single(1),
  HallStallCurrent=single(0.5),
  SpeedFilterAlpha=single(0.02),
  HallGainSpeed=single(80),
  HallMinGainScale=single(0.2),
  ZcBlankTicks=uint16(4),
  ZcHysteresis=single(0.02),
  FloatCurrentLimit=single(0.05),
  ZcMinTicks=uint32(20),
  ZcMaxTicks=uint32(8000),
  ZcRequired=uint16(6),
  ZcTimeoutFactor=single(2.5),
  ZcMinSpeed=single(60),
  AcquireSpacing=uint16(4),
  AcquireMinVoltage=single(0.2),
  AcquireTimeout=single(0.01),
  LowSpeedThreshold=single(75),
  PositionMode=uint8(0),
  CurrentSenseMode=uint8(0),
  MinModulation=single(0),
  DemagBlankFraction=single(0.2),
  DemagRailMargin=single(0.3),
  DemagReleaseTicks=uint16(2),
  ActuationDelayTicks=uint16(0)), DataType="Bus: tBldcParams")