% Simulink data dictionary McData.sldd

tSnrHall = Simulink.Bus()
  HA: uint8
  HB: uint8
  HC: uint8

tSnrResolver = Simulink.Bus()
  A: uint8
  B: uint8
  C: uint8

tSnrEncoder = Simulink.Bus()
  A: uint8
  B: uint8
  C: uint8

tSnrBemf = Simulink.Bus()
  BemfA: uint16
  BemfB: uint16
  BemfC: uint16

tSnrVot = Simulink.Bus()
  Va: uint16
  Vb: uint16
  Vc: uint16

tSnrCur = Simulink.Bus()
  Ia: uint16
  Ib: uint16
  Ic: uint16

tMcSensor = Simulink.Bus()
  AdcI: Bus: tSnrCur
  AdcV: Bus: tSnrVot
  Bemf: Bus: tSnrBemf
  Hall: Bus: tSnrHall
  Resolver: Bus: tSnrResolver
  Encoder: Bus: tSnrEncoder

tMcActuator = Simulink.Bus()
  ActrState: uint8
  PwmDuty: Bus: tActrDuty

tActrDuty = Simulink.Bus()
  AH: uint16
  AL: uint16
  BH: uint16
  BL: uint16
  CH: uint16
  CL: uint16

tAlgoPI = Simulink.Bus()
  Kp: single
  Ki: single
  Ts: single
  Integral: single

tMcAlgorithm = Simulink.Bus()
  SpdPI: Bus: tAlgoPI
  IdPI: Bus: tAlgoPI
  IqPI: Bus: tAlgoPI

tDataDualU16 = Simulink.Bus()
  D1: uint16
  D2: uint16

tDataTriU16 = Simulink.Bus()
  D1: uint16
  D2: uint16
  D3: uint16

tDataQuadU16 = Simulink.Bus()
  D1: uint16
  D2: uint16
  D3: uint16
  D4: uint16

tDataPentaU16 = Simulink.Bus()
  D1: uint16
  D2: uint16
  D3: uint16
  D4: uint16
  D5: uint16

tDataHexaU16 = Simulink.Bus()
  D1: uint16
  D2: uint16
  D3: uint16
  D4: uint16
  D5: uint16
  D6: uint16

tDataDualF32 = Simulink.Bus()
  D1: single
  D2: single

tDataTriF32 = Simulink.Bus()
  D1: single
  D2: single
  D3: single

tDataQuadF32 = Simulink.Bus()
  D1: single
  D2: single
  D3: single
  D4: single

tDataPentaF32 = Simulink.Bus()
  D1: single
  D2: single
  D3: single
  D4: single
  D5: single

tDataHexaF32 = Simulink.Bus()
  D1: single
  D2: single
  D3: single
  D4: single
  D5: single
  D6: single

tMcDataFlow = Simulink.Bus()
  AngleElc: single
  WElc: single
  WReqElc: single
  DcBusCurRaw: uint16
  DcBusCurFlt: single
  DcBusVotRaw: uint16
  DcBusVotFlt: single
  CurPhRaw: Bus: tDataTriU16
  CurPhFlt: Bus: tDataTriF32
  CurAlBeFlt: Bus: tDataDualF32
  CurDqFlt: Bus: tDataDualF32
  CurDqReqFlt: Bus: tDataDualF32
  VotDqFlt: Bus: tDataDualF32
  VotAlBeFlt: Bus: tDataDualF32
  VotPhFlt: Bus: tDataTriF32
  DutyTriFlt: Bus: tDataTriF32
  DutyHexaFlt: Bus: tDataHexaF32

tMcType = Simulink.Bus()
  MotorType: Enum: eMotorType
  AlgorithmType: uint8
  SensorType: uint8
  ControlType: uint8

tMcFault = Simulink.Bus()
  SnrFault: uint8
  AlgoFault: uint8
  ActrFault: uint8
  HwFault: uint8

tMcDebug = Simulink.Bus()
  DebugEn: boolean
  DebugChannel: uint8
  DebugData: uint8[8]

tMcTuning = Simulink.Bus()
  SpdKp: uint16
  SpdKi: uint16
  IdKp: uint16
  IdKi: uint16
  IqKp: uint16
  IqKi: uint16
  AlignCurrent: uint16
  AlignTime: uint16
  OpenLoopAccel: uint16
  TrackingGain: uint16

eSmEvent = enum(StorageType="uint8")
  EventNA = 0
  InitDone = 1
  FaultDetected = 2
  StopDone = 3
  Shutdown = 4
  AlignDone = 5
  OpenIfDone = 6
  OpenVfDone = 7
  TrackingDone = 8
  RunBackward = 9
  TrackingBackward = 10

eSmStates = enum(StorageType="uint8")
  MC_STATE_RESET = 0
  MC_STATE_INIT = 1
  MC_STATE_IDLE = 2
  MC_STATE_FAULT = 3
  MC_STATE_READY = 4
  MC_STATE_READY_2_ALIGN = 5
  MC_STATE_ALIGN = 6
  MC_STATE_ALIGN_2_OPEN_IF = 7
  MC_STATE_OPEN_IF = 8
  MC_STATE_OPEN_IF_2_TRACKING = 9
  MC_STATE_TRACKING_2_OPEN_IF = 10
  MC_STATE_TRACKING = 11
  MC_STATE_TRACKING_2_RUN = 12
  MC_STATE_RUN_2_TRACKING = 13
  MC_STATE_RUN = 14
  MC_STATE_STOP = 15

tMcStateMachine = Simulink.Bus()
  State: Enum: eSmStates
  Cmd: Enum: eSmCmd
  Event: Enum: eSmEvent

eMotorType = enum(DefaultValue="MC_MOTOR_NA")
  MC_MOTOR_NA = 0
  MC_MOTOR_PMSM = 1
  MC_MOTOR_BLDC = 2
  MC_MOTOR_DCM = 3

eSmCmd = enum(DefaultValue="SmReset", StorageType="uint8")
  SmReset = 0
  FaultTrigger = 1
  FaultClear = 2
  AppOn = 3
  AppOff = 4
  MotorRun = 5
  MotorStop = 6

eMcCtrl = enum(DefaultValue="McNotStart", StorageType="uint8")
  McNotStart = 0
  McStart = 1
  McExit = 2

ePosAlgo = enum(DefaultValue="PosNA")
  PosNA = 0
  PosEncoder = 1
  PosHall = 2
  PosResolver = 3
  PosBemf = 4
  PosHfi = 5
  PosFlux = 6

tMotorPara = Simulink.Bus()
  NomVoltage: single
  NomCurrent: single
  NornSpd: single
  PolePairNum: uint8
  Ld: single
  Lq: single
  Rs: single
  Bemf: single
  Flux: single
  RotorInertia: single
  Kt: single
  Ke: single
  Fdamp: single

tMcDrive = Simulink.Bus()
  BasicCnt: uint32
  McCtrl: Enum: eMcCtrl
  McType: Bus: tMcType
  StateMachine: Bus: tMcStateMachine
  DebugInfo: Bus: tMcDebug
  Tunning: Bus: tMcTuning
  McCfg: Bus: tMcCfg
  MotorPara: Bus: tMotorPara

tMcCfg = Simulink.Bus()
  MotorNum: int8
  TuningEn: boolean
  DebugEn: boolean
  SampleRate: uint32
  PwmFreq: uint32
  PosAlgo: Enum: ePosAlgo

tMcDrive_Param = Simulink.Parameter(struct(
  BasicCnt=uint32(0),
  McCtrl=eMcCtrl.McNotStart,
  McType=struct(MotorType=eMotorType.MC_MOTOR_NA, AlgorithmType=uint8(0), SensorType=uint8(0), ControlType=uint8(0)),
  StateMachine=struct(State=eSmStates.MC_STATE_RESET, Cmd=eSmCmd.SmReset, Event=eSmEvent.EventNA),
  DebugInfo=struct(DebugEn=false, DebugChannel=uint8(0), DebugData=uint8(repmat(0, 8, 1))),
  Tunning=struct(
    SpdKp=uint16(0),
    SpdKi=uint16(0),
    IdKp=uint16(0),
    IdKi=uint16(0),
    IqKp=uint16(0),
    IqKi=uint16(0),
    AlignCurrent=uint16(0),
    AlignTime=uint16(0),
    OpenLoopAccel=uint16(0),
    TrackingGain=uint16(0)),
  McCfg=struct(
    MotorNum=int8(0),
    TuningEn=false,
    DebugEn=false,
    SampleRate=uint32(0),
    PwmFreq=uint32(0),
    PosAlgo=ePosAlgo.PosNA),
  MotorPara=struct(
    NomVoltage=single(0),
    NomCurrent=single(0),
    NornSpd=single(0),
    PolePairNum=uint8(0),
    Ld=single(0),
    Lq=single(0),
    Rs=single(0),
    Bemf=single(0),
    Flux=single(0),
    RotorInertia=single(0),
    Kt=single(0),
    Ke=single(0),
    Fdamp=single(0))), DataType="Bus: tMcDrive")

license_info = struct(
  name="MIT License",
  spdx_id="MIT",
  url="https://opensource.org/license/mit",
  copyright="Copyright (c) 2026 autoMBD",
  holder="autoMBD",
  year=2026,
  language="en+zh",
  full_text="The MIT License \nMIT许可证\n<https://opensource.org/license/mit>\n\nSPDX short identifier / SPDX 短标识符：MIT \n\nCopyright (c) 2026 autoMBD\n版权所有 (c) 2026 autoMBD\n\nPermission is hereby granted, free of charge, to any person obtaining a copy of this software and associated documentation files (the \"Software\"), to deal in the Software without restriction, including without limitation the rights to use, copy, modify, merge, publish, distribute, sublicense, and/or sell copies of the Software, and to permit persons to whom the Software is furnished to do so, subject to the following conditions:\n特此向获得本软件及相关文档（合称\"本软件\"）副本的任何人免费授予不受限制地利用本软件的许可，包括而不限于：使用、复制、修改、合并、发布、分发、分许可和/或销售本软件副本，并允许本软件的接收者也获得前述许可，但须遵守以下条件：\n\nThe above copyright notice and this permission notice shall be included in all copies or substantial portions of the Software.\n以上版权声明及本许可声明应包含在本软件的所有副本或主要部分中。\n\nTHE SOFTWAREISPROVIDED\"ASIS\",WITHOUT WARRANTYOFANYKIND, EXPRESS OR IMPLIED, INCLUDING BUT NOT LIMITEDTO THEWARRANTIESOF MERCHANTABILITY, FITNESS FOR APARTICULAR PURPOSE AND NONINFRINGEMENT. IN NO EVENTSHALLTHEAUTHORSORCOPYRIGHT HOLDERSBELIABLE FORANYCLAIM,DAMAGESOROTHERLIABILITY,WHETHER IN ANACTIONOFCONTRACT,TORTOROTHERWISE,ARISINGFROM,OUTOFORIN CONNECTIONWITHTHESOFTWAREORTHEUSEOROTHERDEALINGSINTHE SOFTWARE.\n本软件系\"按原样\"提供，不包含任何形式的明示或默示保证，包括但不限于适销性、特定目的适用性及不侵权的保证。在任何情况下，无论是在合同、侵权或其他案件中，作者或版权持有人均不对因本软件、或因本软件的使用或其他利用而引起的、引发的或与之相关的任何权利主张、损害赔偿或其他责任承担责任。\n")